# Grasshopper definition gh_testSite.gh (Grasshopper 1.0.7)
# plug-ins: TableUiAdapter

panel = Panel("C:\\Users\\nshikada\\Documents\\GitHub\\table\\src\\tb-detection\\")
trigger = Trigger(Interval=-1, TimerInterval=5, Target=tableui)  # disabled
brep = Brep([<brep referenced from the Rhino model> x4])
tableui = TableUiAdapterComponent(Run=Toggle(False), DetectionPath=panel, Models=brep)  # -> Points, Ids, Rotation, Types, Run
panel_2 = Panel(tableui.Run)
c_script = CSharpScript(incoming=tableui.Points)  # -> out, outgoing; inputs incoming: String
# ---------- c_script: C# ----------
    if (incoming != null)
    {
      outgoing = incoming;
      saved = incoming;
    }
    else
    {
      outgoing = saved;
    }
# ---------- c_script: C# additional code ----------
  private string saved;
# ---------- end c_script ----------
pt = Point(c_script.outgoing)
panel_3 = Panel(c_script.outgoing)
