# Grasshopper definition gh_testSite_decoupling.gh (Grasshopper 1.0.7)
# plug-ins: TableUI

trigger = Trigger(Interval=33, TimerInterval=33, Target=tableui)
tableui = TableUIGH_Adapter(URL="5005", Run=Toggle(True), Expire=1000, RepoStrategy="udp")  # -> Points, Ids, Rotation
pt = Point(tableui.Points)
rad = Radians(Degrees=tableui.Rotation)
pdecon = Deconstruct(Point=pt)  # -> XComponent, YComponent, ZComponent
addition = Addition(A="10", B=pdecon.XComponent)
subtraction = Subtraction(A=pdecon.YComponent, B="10")
pt_2 = ConstructPoint(XCoordinate=addition, YCoordinate=0, ZCoordinate=pdecon.ZComponent)
pt_3 = ConstructPoint(XCoordinate=subtraction, YCoordinate=pdecon.YComponent, ZCoordinate=pdecon.ZComponent)
xy = XYPlane(Origin=Point(0, 0, 0))
ln = Line(StartPoint=pt_2, EndPoint=pt_3)
rotate = Rotate(Geometry=ln, Angle=rad, Plane=xy)  # -> Geometry, Transform
