# Grasshopper definition gh_testSite_models.gh (Grasshopper 1.0.7)
# plug-ins: TableUiAdapter

panel = Panel("C:\\Users\\nshikada\\Documents\\GitHub\\table\\src\\tb-detection\\")
trigger = Trigger(Interval=100, TimerInterval=100, Target=tableui)  # disabled
brep = Brep([<brep referenced from the Rhino model> x4])
tableui = TableUiAdapterComponent(Run=Toggle(False), DetectionPath=panel, Models=brep, Variables=Slider(1, range=0..10))  # -> Models, Variables

# ---- group: quick+dirty smoothing
c_script = CSharpScript(incomingData=tableui.Models)  # -> out, outgoingData; inputs incomingData: list of Brep
# ---------- c_script: C# ----------
    if (incomingData == null)
    {
      outgoingData = savedData;
    }
    else
    {
      outgoingData = incomingData;
      savedData = incomingData;
    }
# ---------- c_script: C# additional code ----------
  private List<Brep> savedData;
# ---------- end c_script ----------

# ----
panel_2 = Panel(c_script.outgoingData)
brep_2 = Brep(c_script.outgoingData)

# ---- group: change the color according to the variable
dom = ConstructDomain(DomainStart="-180", DomainEnd="180")
dom_2 = ConstructDomain(DomainStart="0", DomainEnd="255")
item = ListItem(List=tableui.Variables, Index="0", Wrap=True)
remap = RemapNumbers(Value=item, Source=dom, Target=dom_2)  # -> Mapped, Clipped
panel_3 = Panel(remap.Mapped)
rgb = ColourRGB(Alpha=255, Red=remap.Mapped, Green="100", Blue="100")
preview = CustomPreview(Geometry=brep_2, Material=rgb)
